# Dynamo graph 05_Write-CA-Legend.dyn (Dynamo 2.16.4.10216)

# group: Current Project
current = Document.Current()
filePath = Document.FilePath(document=current)

# group: Return the Folder of the Current Project
code_block = CodeBlock { "\\"; }
code_block_2 = CodeBlock { "\\"; }
split = String.Split(string=filePath, separator0=code_block_2)
code_block_3 = CodeBlock { -1; }
dropItems = List.DropItems(list=split, amount=code_block_3)
join = String.Join(separator=code_block, string0=dropItems)

# group: Master Check Template Location
file_path = Filename("Templates\02_Master-Check.xlsx")
file_from_path = FileObject(path=file_path)
string_from_object = FromObject(object=file_from_path)

# group: Return the File Name of the Master Check Template
code_block_4 = CodeBlock { "\\"; }
code_block_5 = CodeBlock { "\\"; }
split_2 = String.Split(string=string_from_object, separator0=code_block_5)
lastItem = List.LastItem(list=split_2)
join_2 = String.Join(separator=code_block_4, string0=lastItem)

# group: Combine Into the Current Project Path and Template Name for Master Check
code_block_6 = CodeBlock { "\\"; }
combinePath = FileSystem.CombinePath(string0=join, string1=join_2)
join_3 = String.Join(separator=code_block_6, string0=combinePath)

# group: Read from Takeoff Excel
file_from_path_2 = FileObject(path=join_3)
string = StringInput("CA")
boolean = BoolSelector(true)
boolean_2 = BoolSelector(true)
importExcel = Data.ImportExcel(file=file_from_path_2, sheetName=string, readAsStrings=boolean, showExcel=boolean_2)

code_block_7 = CodeBlock { 1; }
flatten = List.Flatten(list=importExcel, amount=code_block_7)
python_script = Python(IN[0]=flatten)  # CPython3
# ---------- python_script.python (36 lines) ----------
# Input from Excel Import Node (flattened data)
excel_data = IN[0]

# Initialize an empty list to hold the data in the desired list of lists format
data_rows = []

try:
    # Iterate through each row in the Excel data
    for row in excel_data:
        # Ensure row is a list and has meaningful data in the first six fields (Header, SubHeader, Type, Existing, Proposed, Variation)
        if isinstance(row, list) and len(row) >= 6:
            # Extract and format the required data, providing sensible default values where necessary
            header = row[0] if row[0] is not None else "N/A"
            sub_header = row[1] if row[1] is not None else "N/A"
            item_type = row[2] if row[2] is not None else "N/A"
            existing = row[3] if row[3] is not None else 0
            proposed = row[4] if row[4] is not None else 0
            variation = row[5] if row[5] is not None else 0

            # Only include rows with meaningful sub-header data (ignore entirely empty rows)
            if sub_header != "N/A":
                # Create a list for the row, keeping fields in the correct order
                row_list = [header, sub_header, item_type, existing, proposed, variation]

                # Append the row list to the data rows
                data_rows.append(row_list)

    # Set output to the list of lists
    if not data_rows:
        OUT = "No valid rows found in input data. Check the structure of the input or revise the extraction logic."
    else:
        OUT = data_rows

except Exception as e:
    # Output any errors that occur
    OUT = "Error occurred: {}".format(str(e))
# ----------------------------------------
watch = Watch(python_script)

# group: Sub-Header in Excel
python_script_2 = Python(IN[0]=watch)  # CPython3; frozen; unwired: IN[1]
# ---------- python_script_2.python (81 lines) ----------
import clr
clr.AddReference("RevitAPI")
clr.AddReference("RevitServices")
from Autodesk.Revit.DB import *
from RevitServices.Persistence import DocumentManager
import re

# Inputs
doc = DocumentManager.Instance.CurrentDBDocument
legend_views = IN[0]  # List of Legend View inputs, expected to be a list with one or more elements

# Check and handle if the input is in the expected format
if isinstance(legend_views, list) and len(legend_views) > 0:
    # Extract the first element (assuming it is a Legend View)
    legend_view = UnwrapElement(legend_views[0])
else:
    # If the input does not match the expected format, return an error message
    OUT = "Error: Expected a list with at least one Legend View."
    # Prevent the rest of the code from executing if input is incorrect
    import sys
    sys.exit()

# Proceed with the rest of the script
target_sub_header_text = IN[1]  # The sub-header text to extract (e.g., "MULTI-DECK FROZEN FOOD")

# Collect all TextNote elements in the Legend View
collector = FilteredElementCollector(doc, legend_view.Id).OfClass(TextNote)
text_notes = []

for text_note in collector:
    location = text_note.Coord  # XYZ location of the Text Note
    element_data = {
        "ElementId": text_note.Id.IntegerValue,
        "Text": text_note.Text,
        "Location": location
    }
    text_notes.append(element_data)

# Preprocess the target text to remove extra whitespace and normalize line breaks
target_sub_header_text_clean = re.sub(r'\s+', ' ', target_sub_header_text.strip()).upper()

# Group text notes by rows (based on Y-coordinate)
tolerance = 0.1  # Tolerance for determining whether two text notes are in the same row
rows = []

for text_note in text_notes:
    y_coord = text_note["Location"].Y
    found_row = False
    for row in rows:
        if abs(row[0]["Location"].Y - y_coord) < tolerance:
            row.append(text_note)
            found_row = True
            break
    if not found_row:
        rows.append([text_note])

# Sort rows by Y-coordinate (descending order for top to bottom)
sorted_rows = sorted(rows, key=lambda r: -r[0]["Location"].Y)

# Sort elements within each row by X-coordinate (ascending order for left to right)
for row in sorted_rows:
    row.sort(key=lambda e: e["Location"].X)

# Find the row that matches the target sub-header text
target_row_data = None

for row in sorted_rows:
    # Check each element in the row to find the target text
    for element in row:
        element_text_clean = re.sub(r'\s+', ' ', element["Text"].strip()).upper()
        if element_text_clean == target_sub_header_text_clean:
            target_row_data = row
            break
    if target_row_data:
        break

# Output the matched row (sub-header row) if found, otherwise output a helpful message
if target_row_data:
    OUT = target_row_data
else:
    OUT = f"No matching sub-header found for: '{target_sub_header_text}'."
# ----------------------------------------

watch_2 = Watch(python_script_2)
watch_3 = Watch(flatten)
code_block_8 = CodeBlock { ["DSP Comp Ref (Portrait)", "DSP Comp Ref (Landscape)"]; }
python_script_3 = Python(IN[0]=code_block_8)  # CPython3
# ---------- python_script_3.python (37 lines) ----------
import clr
clr.AddReference("RevitAPI")
clr.AddReference("RevitServices")
from Autodesk.Revit.DB import *
from RevitServices.Persistence import DocumentManager

# Inputs
doc = DocumentManager.Instance.CurrentDBDocument

# Check if input is received
if len(IN) < 1 or not IN[0]:
    OUT = "Error: Please provide a list of legend names."
    raise SystemExit

# List of legend names to find
legend_names = IN[0]

# Ensure the input is a list of strings
if not isinstance(legend_names, list) or not all(isinstance(name, str) for name in legend_names):
    OUT = "Error: Input must be a list of strings representing legend names."
    raise SystemExit

# Get all views in the document
collector = FilteredElementCollector(doc).OfClass(View)

# Filter only Legend Views with names that match the list provided
matching_legends = []
for view in collector:
    if view.ViewType == ViewType.Legend and view.Name.strip() in [name.strip() for name in legend_names]:
        # Append name and Element ID as a list
        matching_legends.append([view.Name, view.Id.IntegerValue])

# Check if the legend was found and output the result
if not matching_legends:
    OUT = f"No legends found matching the provided names: {legend_names}"
else:
    OUT = matching_legends
# ----------------------------------------
watch_4 = Watch(python_script_3)
code_block_9 = CodeBlock { 1; }
getItemAtIndex = List.GetItemAtIndex(list=python_script_3@L2, index=code_block_9)
watch_5 = Watch(getItemAtIndex)

# group: PRODUCE
code_block_10 = CodeBlock { "MULTI-DECK PRODUCE"; }

# group: BEVERAGE
code_block_11 = CodeBlock { "MULTI-DECK SINGLE SERVE BEV"; }

# group: SERVICE DELI
code_block_12 = CodeBlock { "SERVICE DELI COLD CASE"; }
code_block_13 = CodeBlock { "SERVICE DELI HOT CASE"; }
code_block_14 = CodeBlock { "SUSHI"; }
code_block_15 = CodeBlock { "SERVICE SANDWICH"; }
code_block_16 = CodeBlock { "LOW PROFILE DELI CASE"; }
code_block_17 = CodeBlock { "MULTI-DECK DELI CASE"; }

# group: DAIRY & MEAT / DELI
code_block_18 = CodeBlock { "DAIRY COOLER DOORS (DOOR QTY x 2.5)"; }
code_block_19 = CodeBlock { "MULTI-DECK MEAT DELI"; }
code_block_20 = CodeBlock { "TOTAL MULTI-DECK DAIRY & MEAT/DELI"; }

# group: SEAFOOD & MEAT
code_block_21 = CodeBlock { "SERVICE SEAFOOD"; }
code_block_22 = CodeBlock { "SERVICE MEAT"; }
code_block_23 = CodeBlock { "MULTI-DECK MEAT"; }

code_block_24 = CodeBlock { "WINE / LIQUOR SHELVING"; }

# group: TAB
code_block_25 = CodeBlock { "MULTI-DECK BEER / WINE"; }
code_block_26 = CodeBlock { "MULTI-DECK PREMIUM WINE"; }
wine_liquor_lf = CodeBlock(X=code_block_24) { X; }
wine_liquor_slf = CodeBlock(X=code_block_24) { X; }

# group: FROZEN FOOD
code_block_27 = CodeBlock { "MULTI-DECK FROZEN FOOD"; }
code_block_28 = CodeBlock { "MULTI-DECK FROZEN PROMO"; }
code_block_29 = CodeBlock { "MULTI-DECK SEAFOOD & MEAT"; }
code_block_30 = CodeBlock()
# ---------- code_block_30.designscript (2 lines) ----------
"TOTAL FROZEN FOOD
(NUMBER OF DOORS)";
# ----------------------------------------

# group: SHELVING
code_block_31 = CodeBlock { "CENTER STORE SHELVING"; }
wine_liquor_lf_2 = CodeBlock(X=code_block_24) { X; }
code_block_32 = CodeBlock { "TOTAL SHELVING"; }

process_revit_legend = Python(IN[0]=watch_5, IN[1]=code_block_10, IN[2]=code_block_11, IN[3]=code_block_12, IN[4]=code_block_13, IN[5]=code_block_14, IN[6]=code_block_15, IN[7]=code_block_16, IN[8]=code_block_17, IN[9]=code_block_18, IN[10]=code_block_19, IN[11]=code_block_20, IN[12]=code_block_21, IN[13]=code_block_22, IN[14]=code_block_23, IN[15]=code_block_25, IN[16]=code_block_26, IN[17]=wine_liquor_lf, IN[18]=wine_liquor_slf, IN[19]=code_block_27, IN[20]=code_block_28, IN[21]=code_block_29, IN[22]=code_block_30, IN[23]=code_block_31, IN[24]=wine_liquor_lf_2, IN[25]=code_block_32)  # CPython3
# ---------- process_revit_legend.python (151 lines) ----------
import clr
clr.AddReference('RevitServices')
clr.AddReference('RevitAPI')
clr.AddReference('RevitNodes')

import Revit
from RevitServices.Persistence import DocumentManager
from RevitServices.Transactions import TransactionManager
import Revit.Elements as RevitElements
from Revit.Elements import TextNote as RevitTextNote
clr.ImportExtensions(Revit.Elements)
clr.AddReference("RevitAPIUI")
from Autodesk.Revit.DB import FilteredElementCollector, Viewport, BuiltInCategory, TextNote, View, ViewType, ElementId
import re

# Dynamo Inputs
doc = DocumentManager.Instance.CurrentDBDocument

# Handle direct input of view_id, ensuring it's treated properly as an integer ElementId
view_id_input = IN[0]

# Ensure the input is a valid single value (e.g., if it is a list, extract the first element)
if isinstance(view_id_input, list) and len(view_id_input) > 0:
    view_id_input = view_id_input[0]

# Check if the input is already an integer or can be converted to an integer
if isinstance(view_id_input, ElementId):
    view_id = view_id_input
elif isinstance(view_id_input, int):
    view_id = ElementId(view_id_input)
elif isinstance(view_id_input, str) and view_id_input.isdigit():
    view_id = ElementId(int(view_id_input))
else:
    raise TypeError("view_id_input must be an ElementId, int, or a numeric string")

# Collect all TextNote elements in the specified view
collector = FilteredElementCollector(doc, view_id).OfClass(TextNote)
all_text_notes = []

# Extract data from each TextNote
for text_note in collector:
    location = text_note.Coord  # XYZ location of the Text Note
    element_data = {
        "ElementId": text_note.Id.IntegerValue,
        "Text": text_note.Text.strip(),
        "Location": location
    }
    all_text_notes.append(element_data)

# Step 3: Group TextNotes by rows and columns
tolerance = 0.1  # Tolerance for grouping elements by rows
rows = []

# Organize text notes into rows based on Y-coordinate
for text_note in all_text_notes:
    y_coord = text_note["Location"].Y
    found_row = False
    for row in rows:
        if abs(row[0]["Location"].Y - y_coord) < tolerance:
            row.append(text_note)
            found_row = True
            break
    if not found_row:
        rows.append([text_note])

# Sort rows by Y-coordinate (descending order for top-to-bottom)
rows = sorted(rows, key=lambda r: -r[0]["Location"].Y)

# Sort text notes within each row by X-coordinate (ascending order for left-to-right)
for row in rows:
    row.sort(key=lambda tn: tn["Location"].X)

# Gather all sub-header inputs dynamically
sub_headers = [str(IN[i]).strip() for i in range(1, len(IN))]  # Strip any leading/trailing whitespace or line breaks
sub_headers_cleaned = [re.sub(r'\s+', ' ', sh.strip()).upper() for sh in sub_headers]  # Clean sub-header inputs

# Step 4: Extract data for each sub-header
sub_header_data = []

for sub_header in sub_headers_cleaned:
    matched_rows = []

    # Find all rows that match the sub-header, ensuring we are not mistakenly matching headers
    for row in rows:
        for text_note in row:
            note_text_clean = re.sub(r'\s+', ' ', text_note["Text"].strip()).upper()
            # Ensure an exact match with the sub-header
            if sub_header == note_text_clean:
                matched_rows.append(row)
                break

    # If matching rows are found, extract the type, existing, proposed, and variation values for each matched row
    if matched_rows:
        for matched_row in matched_rows:
            # Extract Type, Existing, Proposed, and Variation from the matched row
            type_value = "Type Not Found"
            existing_value, proposed_value, variation_value = "Not Found", "Not Found", "Not Found"
            existing_index, proposed_index, variation_index = "Not Found", "Not Found", "Not Found"

            for text_note in matched_row:
                note_text = text_note["Text"].strip().upper()

                # Determine Type (e.g., LF, SLF, DR)
                type_match = re.search(r'\b(LF|SLF|DR)\b', note_text)
                if type_match:
                    type_value = type_match.group(1)

                # Determine Existing, Proposed, and Variation Values
                if "EXISTING" in note_text:
                    existing_value = note_text
                    existing_index = text_note["ElementId"]
                elif "PROPOSED" in note_text:
                    proposed_value = note_text
                    proposed_index = text_note["ElementId"]
                elif "VARIATION" in note_text:
                    variation_value = note_text
                    variation_index = text_note["ElementId"]

            # Compile the extracted information for the sub-header
            sub_header_entry = [
                sub_header,          # Sub-Header
                [
                    matched_row[0]["Text"] if matched_row else "No Matching Sub-Header",  # The matching TextNote or "No Matching Sub-Header"
                    type_value,          # Type
                    existing_value,      # Existing Value
                    existing_index,      # Existing Index
                    proposed_value,      # Proposed Value
                    proposed_index,      # Proposed Index
                    variation_value,     # Variation Value
                    variation_index      # Variation Index
                ]
            ]
            sub_header_data.append(sub_header_entry)
    else:
        # If no matching row is found, append a "not found" entry
        sub_header_data.append([
            sub_header,    # Sub-Header
            [
                "No Matching Sub-Header",
                "Type Not Found",
                "Existing Value Not Found",
                "Existing Index Not Found",
                "Proposed Value Not Found",
                "Proposed Index Not Found",
                "Variation Not Found",
                "Variation Index Not Found"
            ]
        ])

# Output the collected sub-header data as a list of lists
OUT = sub_header_data
# ----------------------------------------
watch_6 = Watch(process_revit_legend)
